# Grasshopper definition koch snowflake.gh (Grasshopper 1.0.7)
# plug-ins: IteratorGH

# ---- group: iterations
# Parameters
panel = Panel("4")

# ---- group: approx width (mm)
panel_2 = Panel("150")

# ---- group: thickness (mm)
panel_3 = Panel("10")

# ---- group: base triangle definition
pt = ConstructPoint(XCoordinate=0, YCoordinate=0, ZCoordinate=0)
X = UnitX(Factor=1)
rotate = Rotate(Geometry=X, Angle="-Pi/6", Plane=PlaneXY(0, 0, 0))  # -> Geometry, Transform
series = Series(Start="2*Pi/3", Step="2*Pi/3", Count="2")
rotate_2 = Rotate(Geometry=rotate.Geometry, Angle=series, Plane=PlaneXY(0, 0, 0))  # -> Geometry, Transform
vec = Vector([rotate_2.Geometry, rotate.Geometry])
division = Division(A=panel_2, B=2)
multiplication = Multiplication(A=flatten(vec), B=division)
# Main script
move = Move(Geometry=pt, Motion=multiplication)  # -> Geometry, Transform
pline = PolyLine(Vertices=flatten(move.Geometry), Closed=True)
explode = Explode(Curve=pline, Recursive=True)  # -> Segments, Vertices

# ---- group: loop controls
octopus_loop = OctopusLoop(
    Repeat=panel,
    Trigger=Toggle(True),
    HistoryRecord=Toggle(True),
    D0=explode.Segments,
    iterParameters_propagates_propagate0_class="Grasshopper.Kernel.Parameters.Param_Integer, Grasshopper, Version=7.29.23107.3001, Culture=neutral, PublicKeyToken=dda4f5ec2cd80803",
    iterParameters_propagates_propagate0_id="C",
    iterParameters_propagates_propagate0_numTargets=0,
    iterParameters_propagates_propagate1_class="Grasshopper.Kernel.Parameters.Param_GenericObject, Grasshopper, Version=7.29.23107.3001, Culture=neutral, PublicKeyToken=dda4f5ec2cd80803",
    iterParameters_propagates_propagate1_id="D0",
    iterParameters_propagates_propagate1_numTargets=1,
    iterParameters_propagates_propagate1_target=shatter,
    iterParameters_receivers_receiver0_class="Grasshopper.Kernel.Parameters.Param_Boolean, Grasshopper, Version=7.29.23107.3001, Culture=neutral, PublicKeyToken=dda4f5ec2cd80803",
    iterParameters_receivers_receiver0_id="E",
    iterParameters_receivers_receiver0_numTargets=0,
    iterParameters_receivers_receiver1_class="Grasshopper.Kernel.Parameters.Param_GenericObject, Grasshopper, Version=7.29.23107.3001, Culture=neutral, PublicKeyToken=dda4f5ec2cd80803",
    iterParameters_receivers_receiver1_id="D0",
    iterParameters_receivers_receiver1_numTargets=1,
    iterParameters_receivers_receiver1_target=crv_3,
    EvaluationUnits_unit0_description="Loop evaluation unit",
    EvaluationUnits_unit0_name="IO",
    EvaluationUnits_unit0_numControllers=2,
    EvaluationUnits_unit0_numPropagates=2,
    EvaluationUnits_unit0_numReceivers=2,
    EvaluationUnits_unit0_propagate0_id="C",
    EvaluationUnits_unit0_propagate1_id="D0",
    EvaluationUnits_unit0_receiver0_id="E",
    EvaluationUnits_unit0_receiver1_id="D0")  # -> Timer, D0
crv = Curve(octopus_loop.D0)
concat = Concatenate(FragmentA="{", FragmentC=panel, FragmentB=";*;*}")
split = SplitTree(Data=crv, Masks=flatten(concat))  # -> Positive, Negative

# ---- group: loop contents
shatter = Shatter(Curve=reparameterize(explode.Segments), Parameters=["1/3", "2/3"])  # -> simplify(Segments)
item = ListItem(List=shatter, Index="1", Wrap=True)
item_2 = ListItem(List=shatter, Index=0, Wrap=True)  # -> Item1, Item
end = EndPoints(Curve=item)  # -> Start, End
crv_2 = Curve([item_2.Item1, item_2.Item])
line = LineSDL(Start=end.End, Direction=Vector(0, 0, 1), Length=1)
line_2 = LineSDL(Start=end.Start, Direction=Vector(0, 0, 1), Length=1)
rotax = RotateAxis(Geometry=item, Angle="-Pi/3", Axis=line_2)  # -> Geometry, Transform
rotax_2 = RotateAxis(Geometry=item, Angle="Pi/3", Axis=line)  # -> Geometry, Transform
crv_3 = Curve([rotax.Geometry, rotax_2.Geometry, crv_2])

# ---- group: create solid
# Make 3D
boundary = BoundarySurfaces(Edges=flatten(split.Positive))
Z = UnitZ(Factor=panel_3)
extr = Extrude(Base=boundary, Direction=Z)

# ---- group: make a hole / hole location parameter
number_slider = Slider(0.13, range=0..1)

# ---- group: make a hole / hole radius (mm)
panel_4 = Panel("2")

# ---- group: make a hole
multiplication_2 = Multiplication(A=panel_2, B=number_slider)
Y = UnitY(Factor=multiplication_2)  # -> expr("-x", UnitVector)
item_3 = ListItem(List=move.Geometry, Index=1, Wrap=True)
move_2 = Move(Geometry=item_3, Motion=Y)  # -> Geometry, Transform
circle = CircleCNR(Center=move_2.Geometry, Normal=Vector(0, 0, 1), Radius=panel_4)
extr_2 = Extrude(Base=circle, Direction=Z)
cap = CapHoles(Brep=extr_2)
sdiff = SolidDifference(BrepsA=extr, BrepsB=cap)

# ---- group: result
brep = Brep(sdiff)
